# Grasshopper definition lamptest.gh (Grasshopper 1.0.7)

# ----
# https://www.flinders.be/flos-ic-lights-t1-high-tafellamp?c=18770
number_slider = Slider(10, range=10..20)
circle = Circle(Plane=PlaneXY(0, 0, 0), Radius=number_slider)
addition = Addition(A=number_slider, B=Slider(10, range=1..10))
unit_z = UnitZ(Factor=addition)
divide_curve = DivideCurve(Curve=circle, Count=Slider(3, range=3..6), Kinks=False)  # -> Points, Tangents, Parameters
area = Area(Geometry=circle)  # -> Area, Centroid
move = Move(Geometry=area.Centroid, Motion=unit_z)  # -> Geometry, Transform
line = Line(StartPoint=area.Centroid, EndPoint=divide_curve.Points)
construct_point = ConstructPoint(XCoordinate=Slider(12, range=10..20), YCoordinate=0, ZCoordinate=Slider(17, range=10..20))
line_2 = Line(StartPoint=area.Centroid, EndPoint=move.Geometry)
line_3 = Line(StartPoint=move.Geometry, EndPoint=construct_point)
number_slider_2 = Slider(1, range=1..4)
join_curves = JoinCurves(Curves=[line_2, line_3], Preserve=False)
point_on_curve = PointOnCurve(line, parameter=0.711)
fillet = Fillet(Curve=join_curves, Radius=Slider(2, range=1..2))
pipe = Pipe(Curve=[line, fillet], Radius=number_slider_2, Caps=Slider(1, range=0..2))
deconstruct_brep = DeconstructBrep(Brep=flatten(pipe))  # -> Faces, Edges, Vertices
addition_2 = Addition(A=number_slider_2, B=Slider(0.3, range=0.1..1))
cylinder = Cylinder(Base=point_on_curve, Radius=addition_2, Length=Slider(1, range=1..2))
list_item = ListItem(List=flatten(deconstruct_brep.Edges), Index=Slider(14, range=0..15), Wrap=True)
list_item_2 = ListItem(List=flatten(deconstruct_brep.Vertices), Index=Slider(15, range=0..15), Wrap=True)
end_points = EndPoints(Curve=[list_item, fillet])  # -> Start, End
xz_plane = XZPlane(Origin=point_on_curve)
cap_holes = CapHoles(Brep=cylinder)
radians = Radians(Degrees="90")
point = Point(end_points.End)
point_on_curve_2 = PointOnCurve(list_item, parameter=0.814)
list_item_3 = ListItem(List=flatten(point), Index=0, Wrap=True)  # -> Item, Item1
number_slider_3 = Slider(6, range=1..10)
vector_2pt = Vector2Pt(PointA=list_item_3.Item1, PointB=list_item_3.Item, Unitize=False)  # -> Vector, Length
list_item_4 = ListItem(List=point_on_curve_2, Index=0, Wrap=True)  # -> Item, Item1
rotate = Rotate(Geometry=flatten(cap_holes), Angle=radians, Plane=xz_plane)  # -> Geometry, Transform
sphere = Sphere(Base=point_on_curve_2, Radius=number_slider_3)
vector_display_ex = VectorDisplayEx(Point=list_item_4.Item1, Vector=vector_2pt.Vector, Colour=RGB(0, 0, 0), Width=2)
multiplication = Multiplication(A=vector_2pt.Vector, B=number_slider_3)
move_2 = Move(Geometry=sphere, Motion=multiplication)  # -> Geometry, Transform

number_slider_4 = Slider(1, range=1..5)
addition_3 = Addition(A=number_slider_4, B=Slider(0.2, range=0.1..1))
radians_2 = Radians(Degrees="90")
colour_picker = ColourPicker(PickedColour=RGB(111, 210, 0))

lengtepootjes = Slider(11, range=10..20)
hoogte_lamp = Slider(19, range=10..20)
aantal_poten = Slider(3, range=3..6)
diameter_bol = Slider(6, range=0..10)

circle_2 = Circle(Plane=PlaneXY(0, 0, 0), Radius=lengtepootjes)
divide_curve_2 = DivideCurve(Curve=circle_2, Count=aantal_poten, Kinks=False)  # -> Points, Tangents, Parameters
area_2 = Area(Geometry=circle_2)  # -> Area, Centroid
unit_z_2 = UnitZ(Factor=hoogte_lamp)
list_item_5 = ListItem(List=divide_curve_2.Points, Index=0, Wrap=True)  # -> Item, Item1
move_3 = Move(Geometry=area_2.Centroid, Motion=unit_z_2)  # -> Geometry, Transform
division = Division(A="360", B=aantal_poten)
line_4 = Line(StartPoint=area_2.Centroid, EndPoint=list_item_5.Item)
deconstruct = Deconstruct(Point=move_3.Geometry)  # -> XComponent, YComponent, ZComponent
series = Series(Start="0", Step=division, Count=aantal_poten)
point_on_curve_3 = PointOnCurve(line_4, parameter=0.714)
addition_4 = Addition(A=deconstruct.XComponent, B=Slider(6, range=1..10))
addition_5 = Addition(A=deconstruct.ZComponent, B=Slider(7, range=1..10))
radians_3 = Radians(Degrees=series)
cylinder_2 = Cylinder(Base=point_on_curve_3, Radius=addition_3, Length=1)
construct_point_2 = ConstructPoint(XCoordinate=addition_4, YCoordinate=0, ZCoordinate=addition_5)
line_5 = Line(StartPoint=move_3.Geometry, EndPoint=construct_point_2)
line_6 = Line(StartPoint=area_2.Centroid, EndPoint=move_3.Geometry)
xz_plane_2 = XZPlane(Origin=point_on_curve_3)
cap_holes_ex = CapHolesEx(Brep=cylinder_2)  # -> Brep, Caps, Solid
join_curves_2 = JoinCurves(Curves=[line_6, line_5], Preserve=False)
rotate_2 = Rotate(Geometry=cap_holes_ex.Brep, Angle=radians_2, Plane=xz_plane_2)  # -> Geometry, Transform
rotate_3 = Rotate(Geometry=line_4, Angle=radians_3, Plane=PlaneXY(0, 0, 0))  # -> Geometry, Transform
rotate_4 = Rotate(Geometry=rotate_2.Geometry, Angle=radians_3, Plane=PlaneXY(0, 0, 0))  # -> Geometry, Transform
fillet_2 = Fillet(Curve=join_curves_2, Radius=Slider(0.9, range=0.1..2))
pipe_2 = Pipe(Curve=fillet_2, Radius=number_slider_4, Caps="1")
pipe_3 = Pipe(Curve=rotate_3.Geometry, Radius=number_slider_4, Caps="1")
deconstruct_brep_2 = DeconstructBrep(Brep=pipe_2)  # -> Faces, Edges, Vertices
list_item_6 = ListItem(List=deconstruct_brep_2.Edges, Index=Slider(5, range=0..6), Wrap=True)

point_on_curve_4 = PointOnCurve(list_item_6, parameter=0.76)

solid_union = SolidUnion(Breps=flatten([pipe_3, pipe_2, rotate_4.Geometry]))
end_points_2 = EndPoints(Curve=list_item_6)  # -> Start, End
point_2 = Point(end_points_2.End)
vector_2pt_2 = Vector2Pt(PointA=construct_point_2, PointB=point_2, Unitize=False)  # -> Vector, Length
multiplication_2 = Multiplication(A=vector_2pt_2.Vector, B=diameter_bol)
move_4 = Move(Geometry=point_on_curve_4, Motion=multiplication_2)  # -> Geometry, Transform
sphere_2 = Sphere(Base=move_4.Geometry, Radius=diameter_bol)
solid_union_2 = SolidUnion(Breps=flatten([solid_union, sphere_2]))
custom_preview = CustomPreview(Geometry=sphere_2, Material=ColourSwatch(SwatchColor=RGB(255, 255, 255)))
custom_preview_2 = CustomPreview(Geometry=solid_union, Material=colour_picker)
